# Grasshopper definition 3DPrinting_process.gh (Grasshopper 1.0.7)
# Copyright: CreativeCommons ShareALikeNotComercial

# ----
# PARAMETROS IMPRESION 3D
profundidad_ondas = Slider(5, range=0..20)
numero_de_ondas = Slider(10, range=0..50)
diametro = Slider(50, range=0..100)
altura = Slider(70, range=0..100)

cluster = Cluster(a=profundidad_ondas, num=diametro, F=altura, A=numero_de_ondas)
brep = Brep(cluster)

# ----
# VISUALIZACION
cluster_2 = Cluster_5(S=brep)
preview = CustomPreview(Geometry=cluster_2, Material=ColourSwatch(SwatchColor=RGB(209, 141, 96)))

delta_printer_diameter = Slider(220, range=0..1000)
delta_printer_height_z = Slider(290, range=0..1000)
cartesian_printer_measure_x = Slider(220, range=0..1000)
cartesian_printer_measure_y = Slider(220, range=0..1000)
cartesian_printer_height_z = Slider(300, range=0..1000)
delta_printer = BooleanToggle(False)
brep_2 = Brep(brep)
cold_extrude = BooleanToggle(False)

# ---- group: OPTIONAL CONFIG
dual_extruder = BooleanToggle(False)
second_extruder = BooleanToggle(False)
dual_extruder_mixer_extruder = BooleanToggle(False)
cooling_fan = BooleanToggle(True)
heated_extruder = BooleanToggle(True)
heated_bead = BooleanToggle(True)
disable_motors_at_end = BooleanToggle(True)
home_at_end = BooleanToggle(False)
metric = BooleanToggle(True)
inch = BooleanToggle(False)
dual_proportional_mixer_ratio = Slider(0.5, range=0..1)
extruder_temperature = Slider(230, range=0..250)
bed_temperature = Slider(60, range=0..120)
final_z_position = Slider(280, range=0..500)
cluster_3 = Cluster_4(
    data_4=metric,
    data_3=inch,
    data_5=cold_extrude,
    data_2=dual_extruder,
    data=second_extruder,
    data_6=dual_extruder_mixer_extruder,
    data_7=dual_proportional_mixer_ratio,
    data_12=cooling_fan,
    data_13=heated_extruder,
    data_15=extruder_temperature,
    data_14=heated_bead,
    data_10=bed_temperature,
    data_11=disable_motors_at_end,
    data_8=home_at_end,
    data_9=final_z_position)

# ----
header = Panel(""";HEADER
;Start_gcode
G21                     ; Set to metric [change to G20 if you want Imperial]
G90                     ; Force coordinates to be absolute relative to the origin
G28                     ; Home X/Y/Z axis
M302 P1			; Disable Cold Extrusion Checking
G92 E0                  ; Reset extruder to [0] zero end of cleaning run
T0
M117 Printing...
;ENDHEADER""")
printer_parameters = PRINTERPARAMETERS(
    geometry_2=brep_2,
    printer_measure_x=cartesian_printer_measure_x,
    printer_measure_y=cartesian_printer_measure_y,
    printer_height_z=cartesian_printer_height_z,
    delta_printer_measure_diameter=delta_printer_diameter,
    L=delta_printer_height_z,
    delta_printer=delta_printer)  # -> centered_geometry_4, printer_geometry_2, log_file_2
panel = Panel("Printer Parameters")
footer = Panel(""";FOOTER
; end_gcode
G91                             ; relative positioning
M107                            ; turn off layer fan				
G90                             ; absolute positioning
;ENDFOOTER""")
panel_2 = Panel(printer_parameters.log_file_2)

tolerance_resolution = Slider(0.2, range=0.01..10)

z_bed_height_offset = Slider(1.2, range=0..10)
noozle_diameter = Slider(3.1, range=0..10)
slicing_distance = Slider(1.3, range=0..20)

panel_3 = Panel(cluster_3)

# ---- group: CONFIG FOR KOSSEL CLAY PRINTING
cluster_4 = Cluster_3(custom_start_gcode=header, custom_endgcode=footer)

# ----
slicing = SLICING(
    geometry=printer_parameters.centered_geometry_4,
    slicing_distance=slicing_distance,
    noozle_diameter=noozle_diameter,
    z_height_offset=z_bed_height_offset,
    tolerance_resolution=tolerance_resolution,
    tolerance_resolution_2=Slider(5, range=0..10))  # -> sliced_geometry_3, settings_flow_2
panel_4 = Panel("Slicing")

stepsbackairtravelling = Slider(0, range=0..50)
extruding_multiplier_e = Slider(2.5, range=0..50)
z_hop_safety_offset_mm = Slider(5, range=0..5)
print_speed_f_mm_s = Slider(900, range=0..3000)
jog_speed_f_mm_s = Slider(4000, range=0..5000)

# ---- group: USING ONLY PRESSURE?
toggle = BooleanToggle(False)
# Retraction of the Material
number_slider = Slider(150, range=0..1000)

# ----
cluster_5 = Cluster_2(
    settings_flow=slicing.settings_flow_2,
    sliced_geometry=slicing.sliced_geometry_3,
    jog_speed_f_mm_s=jog_speed_f_mm_s,
    print_speed_f_mm_s=print_speed_f_mm_s,
    extruding_speed_e=extruding_multiplier_e,
    stepback_retraction_setting=stepsbackairtravelling,
    start_endgcode=cluster_4,
    extrusion_wait=number_slider,
    F=z_hop_safety_offset_mm,
    pressure_control=toggle)  # -> g_code_output_2, total_print_lenght_2, total_print_volume_2, total_print_time_2
panel_5 = Panel("Printing settings")
panel_6 = Panel(cluster_5.total_print_lenght_2)
panel_7 = Panel(cluster_5.total_print_volume_2)
panel_8 = Panel(cluster_5.total_print_time_2)
# GCODE TO COPY AND PRINT
panel_9 = Panel(cluster_5.g_code_output_2)

# ==== cluster Cluster
num = ClusterInput()
xy = XYPlane(Origin=Point(0, 0, 0))
num_2 = Number(expr("x/2", num))
F = ClusterInput()
cir = Circle(Plane=xy, Radius=num_2)
Z = UnitZ(Factor=F)
move = Move(Geometry=cir, Motion=Z)  # -> Geometry, Transform
area = Area(Geometry=move.Geometry)  # -> Area, Centroid
scale = Scale(Geometry=move.Geometry, Center=area.Centroid, Factor=Slider(1.25, range=0..10))  # -> Geometry, Transform
rulesrf = RuledSurface(CurveA=cir, CurveB=scale.Geometry)
number_slider = Slider(3, range=0..10)
dim = Dimensions(Surface=rulesrf)  # -> UDimension, VDimension
division = Division(A=dim.UDimension, B=number_slider)
division_2 = Division(A=dim.VDimension, B=number_slider)
sdivide = DivideSurface(Surface=rulesrf, UCount=division, VCount=division_2)  # -> Points, Normals, Parameters
A = ClusterInput()
flip = FlipMatrix(Data=sdivide.Points)
flip_2 = FlipMatrix(Data=sdivide.Normals)
mod = Modulus(A=A, B="2")
item = ListItem(List=reverse(flip), Index=0, Wrap=True)
addition = Addition(A=A, B="1")
bool = Boolean(mod)
pt = Point(flip)
vec = Vector(flip_2)
filter = StreamFilter(Gate=bool, Stream0=A, Stream1=addition)
expression = Expression(x=vec, Expression="{x.x,x.y,0}")
lng = ListLength(List=pt)
range = Range(Domain=Domain(0, 1), Steps=expr("x-1", lng))
a = ClusterInput()
num_3 = Number(filter)
pi = Pi(Factor=num_3)
expression_2 = Expression(x=range, a=a, b=pi, Expression="a*sin(b*x)")
vec_2 = Vector(expression)
amp = Amplitude(Vector=vec_2, Amplitude=expression_2)
move_2 = Move(Geometry=pt, Motion=amp)  # -> Geometry, Transform
nurbs = NurbsCurve(Vertices=move_2.Geometry, Degree=3, Periodic=False)  # -> Curve, Length, Domain
item_2 = ListItem(List=flatten(nurbs.Curve), Index=0, Wrap=True)
flip_3 = FlipCurve(Curve=nurbs.Curve, Guide=item_2)  # -> Curve, Flag
tstat = TreeStatistics(Tree=flip_3.Curve)  # -> Paths, Length, Count
pi_2 = Pi(Factor="2")
int = Integer(num_3)
dispatch = Dispatch(List=tstat.Paths, DispatchPattern=[True, False])  # -> ListA, ListB
split = SplitTree(Data=flip_3.Curve, Masks=flatten(dispatch.ListA))  # -> Positive, Negative
division_3 = Division(A=pi_2, B=int)
num_4 = Number(expr("x", division_3))
center = Center(Geometrical=split.Negative, forall=True)  # -> Center, Dimension
rotate = Rotate(Geometry=split.Negative, Angle=num_4, Plane=center.Center)  # -> Geometry, Transform
merge = Merge(Data1=split.Positive, Data2=rotate.Geometry)

# ---- group: seam
brep = Brep(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)

# ----
crv = Curve(merge)
bcx = BrepCurve(Brep=brep, Curve=crv)  # -> Curves, Points
crv_cp = CurveClosestPoint(Point=bcx.Points, Curve=crv)  # -> Point, Parameter, Distance
seam = Seam(Curve=crv, Seam=crv_cp.Parameter)
divide = DivideCurve(Curve=seam, Count=Slider(200, range=0..1000), Kinks=False)  # -> Points, Tangents, Parameters
nurbs_2 = NurbsCurve(Vertices=divide.Points, Degree=3, Periodic=invert(False))  # -> Curve, Length, Domain
loft = Loft(
    Curves=flatten(nurbs_2.Curve),
    Options={Adjust=False, Closed=False, LoftEnds=0, LoftSimp=0, LoftType=0, Rebuild=10, Refit=0.01})
brep_2 = Brep(loft)
L = ClusterOutput(loft)

# ==== cluster PRINTERPARAMETERS
delta_printer_measure_diameter = ClusterInput()
L = ClusterInput()
delta_printer = ClusterInput()
geometry = ClusterInput()
geometry_2 = ClusterInput()
printer_measure_x = ClusterInput()
printer_measure_y = ClusterInput()
printer_height_z = ClusterInput()
delta_printer_measure_diameter_2 = Number(delta_printer_measure_diameter)
delta_printer_2 = Boolean(delta_printer)
geometry_3 = Geometry(geometry)
geometry_4 = Geometry(geometry_2)
printer_measure_x_2 = Number(printer_measure_x)
printer_measure_y_2 = Number(printer_measure_y)
printer_height_z_2 = Number(printer_height_z)
brep = Brep(geometry_4)
expression = Expression(x=printer_measure_y_2, Expression="x/2")
expression_2 = Expression(x=printer_measure_x_2, Expression="x/2")
expression_3 = Expression(x=printer_height_z_2, Expression="x/2")
delta_printer_3 = Boolean(delta_printer_2)
expression_4 = Expression(x=delta_printer_measure_diameter_2, Expression="x/2")
pt = ConstructPoint(XCoordinate=expression_2, YCoordinate=expression, PrinterHeightZ=expression_3)
cyl = Cylinder(Base=PlaneXY(0, 0, 0), Radius=expression_4, Length=L)
box = CenterBox(Base=pt, PrinterMeasureX=expression_2, PrinterMeasureY=expression, PrinterHeightZ=expression_3)
debrep = DeconstructBrep(Brep=cyl)  # -> Faces, Edges, Vertices
geometry_5 = Geometry(geometry_3)
geometry_6 = Geometry(brep)
item = ListItem(List=debrep.Edges, Index=Slider(3, range=0..10), Wrap=True)
edges = BrepEdges(Brep=cyl)  # -> Naked, Interior, NonManifold
bbox = BoundingBox(Content=flatten(geometry_5), Plane=PlaneXY(0, 0, 0), UnionBox=True)  # -> Box, Box_2
edges_2 = BrepEdges(Brep=box)  # -> Naked, Interior, NonManifold
bbox_2 = BoundingBox(Content=flatten(geometry_6), Plane=PlaneXY(0, 0, 0), UnionBox=True)  # -> Box, Box_2
area = Area(Geometry=item)  # -> Area, Centroid
boundary = BoundarySurfaces(Edges=item)
box_2 = EvaluateBox(Box=bbox.Box, UParameter=0.5, VParameter=0.5, WParameter=0)  # -> Plane, Point, Include
box_3 = EvaluateBox(Box=bbox_2.Box, UParameter=0.5, VParameter=0.5, WParameter=0)  # -> Plane, Point, Include
item_2 = ListItem(List=edges.Naked, Index=Slider(1, range=0..10), Wrap=True)
debrep_2 = DeconstructBrep(Brep=box)  # -> Faces, Edges, Vertices
merge = Merge(Data1=item_2, Data2=boundary)
item_3 = ListItem(List=debrep_2.Faces, Index=Slider(4, range=0..10), Wrap=True)
area_2 = Area(Geometry=item_3)  # -> Area, Centroid
filter = StreamFilter(Gate=delta_printer_3, Stream0=area_2.Centroid, Stream1=area.Centroid)
filter_2 = StreamFilter(Gate=delta_printer_3, Stream0=area_2.Centroid, Stream1=area.Centroid)
vec2pt = Vector2Pt(PointA=box_2.Point, PointB=filter, Unitize=False)  # -> Vector, Length
vec2pt_2 = Vector2Pt(PointA=box_3.Point, PointB=filter_2, Unitize=False)  # -> Vector, Length
move = Move(Geometry=geometry_5, Motion=vec2pt.Vector)  # -> Geometry, Transform
move_2 = Move(Geometry=geometry_6, Motion=vec2pt_2.Vector)  # -> Geometry, Transform
merge_2 = Merge(Data1=edges_2.Interior, Data2=item_3)
geo = Geometry(merge)
geo_2 = Geometry(merge_2)
filter_3 = StreamFilter(Gate=delta_printer_3, Stream0=geo_2, Stream1=geo)
debox = DeconstructBox(Box=[bbox_2.Box, bbox.Box])  # -> Plane, X, Y, Z
null = NullItem(Item=geometry_5)  # -> NullFlags, InvalidFlags, Description
null_2 = NullItem(Item=geometry_6)  # -> NullFlags, InvalidFlags, Description
bnd = Bounds(Numbers=debox.Z)
bnd_2 = Bounds(Numbers=debox.X)
bnd_3 = Bounds(Numbers=debox.Y)
ma = MassAddition(Input=flatten([null.NullFlags, null_2.NullFlags]))  # -> Result, PartialResults
filter_4 = StreamFilter(Gate=delta_printer_3, Stream0=box, Stream1=cyl)
debrep_3 = DeconstructBrep(Brep=move_2.Geometry)  # -> Faces, Edges, Vertices
centered_geometry = Geometry(move.Geometry)
centered_geometry_2 = Geometry(move_2.Geometry)
dedomain = DeconstructDomain(Domain=bnd)  # -> Start, End
dedomain_2 = DeconstructDomain(Domain=bnd_2)  # -> Start, End
dedomain_3 = DeconstructDomain(Domain=bnd_3)  # -> Start, End
eval = EvaluateCurve(Curve=reparameterize(debrep_3.Edges), Parameter="0.5")  # -> flatten(Point), Tangent, Angle
cap = CapHoles(Brep=filter_4)
equals = Equality(FirstNumber=ma.Result, SecondNumber="0")  # -> Equality, Inequality
pt_2 = ConstructPoint(XCoordinate=dedomain_2.Start, YCoordinate=dedomain_3.Start, ZCoordinate=dedomain.Start)
ma_2 = MassMultiplication(Input=[null.NullFlags, null_2.NullFlags])  # -> Result, PartialResults
expression_5 = Expression(P=pt_2, Expression="Format(\"Print Size X{0:0.00}mm Y{1:0.00}mm Z{2:0.00}mm\", P.x, P.y, P.z)")
brepinc = PointInBrep(Brep=cap, Point=eval.Point, Strict=False)
equals_2 = Equality(FirstNumber=brepinc, SecondNumber="1")  # -> Equality, Inequality
ma_3 = MassMultiplication(Input=brepinc)  # -> Result, PartialResults
ma_4 = MassAddition(Input=equals_2.Inequality)  # -> Result, PartialResults
filter_5 = StreamFilter(Gate=null.NullFlags, Stream0="Your print is a Mesh", Stream1="Your print is a Brep")
filter_6 = StreamFilter(Gate=ma_2.Result, Stream0="Your print is a Brep and a Mesh")
filter_7 = StreamFilter(Gate=equals.Equality, Stream1="Please connect only Brep or Mesh.Not both")
panel = Panel(ma_4.Result)
filter_8 = StreamFilter(Gate=ma_2.Result, Stream1=filter_5)
equals_3 = Equality(FirstNumber=ma_4.Result, SecondNumber="0")  # -> Equality, Inequality
null_3 = NullItem(Item=equals_3.Inequality)  # -> NullFlags, InvalidFlags, Description
merge_3 = Merge(Data1=filter_8, Data2=filter_6)
panel_2 = Panel(equals_3.Inequality)
filter_9 = StreamFilter(
    Gate=equals_3.Inequality,
    Stream0=ColourSwatch(SwatchColor=RGBA(0, 155, 186, 142)),
    Stream1=ColourSwatch(SwatchColor=RGBA(255, 0, 0, 142)))
filter_10 = StreamFilter(Gate=equals_3.Inequality, Stream0=centered_geometry_2)
filter_11 = StreamFilter(Gate=null_3.NullFlags, Stream1=centered_geometry)
filter_12 = StreamFilter(Gate=equals.Equality, Stream0=expression_5)
merge_4 = Merge(Data1=filter_10, Data2=filter_11)
null_4 = NullItem(Item=merge_4)  # -> NullFlags, InvalidFlags, Description
filter_13 = StreamFilter(Gate=null_4.NullFlags, Stream0="No errors,you are good to go", Stream1="Geometry is out of bounds")
filter_14 = StreamFilter(Gate=equals.Equality, Stream0=filter_13, Stream1="Fatal Error")
merge_5 = Merge(Data1=filter_7, Data2=filter_14, Data3=merge_3, Data4=filter_12)
log_file = Data(merge_5)
panel_3 = Panel(log_file)
preview = CustomPreview(Geometry=filter_3, Shader=filter_9)
centered_geometry_3 = Geometry(merge_4)
log_file_2 = ClusterOutput(log_file)
printer_geometry = Geometry(filter_3)
printer_geometry_2 = ClusterOutput(printer_geometry)
centered_geometry_4 = ClusterOutput(centered_geometry_3)
preview_2 = CustomPreview(Geometry=centered_geometry_3, Shader=ColourSwatch(SwatchColor=RGBA(227, 227, 227, 145)))

# ==== cluster Cluster_2
F = ClusterInput()
pressure_control = ClusterInput()
settings_flow = ClusterInput()
jog_speed_f_mm_s = ClusterInput()
print_speed_f_mm_s = ClusterInput()
extruding_speed_e = ClusterInput()
stepback_retraction_setting = ClusterInput()
start_endgcode = ClusterInput()
extrusion_wait = ClusterInput()
sliced_geometry = ClusterInput()
settings_flow_2 = Data(settings_flow)
jog_speed_f_mm_s_2 = Number(jog_speed_f_mm_s)
print_speed_f_mm_s_2 = Number(print_speed_f_mm_s)
extruding_speed_e_2 = Number(extruding_speed_e)
stepback_retraction_setting_2 = Number(stepback_retraction_setting)
start_endgcode_2 = Data(start_endgcode)
sliced_geometry_2 = Geometry(sliced_geometry)
bang = ExplodeTree(Data=start_endgcode_2)  # -> flatten(Branch0), flatten(Branch1)

number_slider = Slider(5, range=0..10)  # disabled
len = Length(Curve=sliced_geometry_2)  # disabled
division = Division(A=len, B=number_slider)  # disabled

g_code_header = Text(bang.Branch0)
g_code_footer = Text(bang.Branch1)

# ---- group: statisitics
item = ListItem(List=settings_flow_2, Index="2", Wrap=True)
noozle_diameter = Number(item)
item_2 = ListItem(List=settings_flow_2, Index="1", Wrap=True)
expression = Expression(x=item_2, Expression="x/4")
len_2 = Length(Curve=flatten(sliced_geometry_2))
ma = MassAddition(Input=len_2)  # -> Result, PartialResults
rectangle = Rectangle(Plane=PlaneXY(0, 0, 0), XSize=item_2, YSize=noozle_diameter, Radius=expression)  # -> Rectangle, Length
expression_2 = Expression(x=ma.Result, y=print_speed_f_mm_s_2, Expression="(x/y)+(x/y)*0.25")
area = Area(Geometry=rectangle.Rectangle)  # -> Area, Centroid
concat = Concatenate(FragmentA=ma.Result, FragmentB=" mm")
expression_3 = Expression(x=ma.Result, y=area.Area, Expression="(x*y)/1000000")
concat_2 = Concatenate(FragmentA=expression_2, FragmentB=" minutes")
concat_3 = Concatenate(FragmentA=expression_3, FragmentB=" liters")

# ----
explode = Explode(Curve=sliced_geometry_2, Recursive=True)  # -> Segments, Vertices
divide = DivideCurve(Curve=sliced_geometry_2, Count=division, Kinks=False)  # -> Points, Tangents, Parameters; disabled
pt = Point(explode.Vertices)
prune = PruneTree(Tree=pt, Minimum="1", Maximum=0)
simplify = SimplifyTree(Tree=prune, Front=False)  # -> flatten(Tree)

# ---- group: E value calculation
shift = ShiftList(List=simplify, Shift=1, Wrap=Toggle(True))
dist = Distance(PointA=simplify, PointB=shift)
cull_i = CullIndex(List=dist, Indices="-1", Wrap=True)
expression_4 = Expression(x=cull_i, y=extruding_speed_e_2, Expression="x*y")
ma_2 = MassAddition(Input=flatten(expression_4))  # -> Result, PartialResults
lng = ListLength(List=expression_4)  # -> flatten(Length)
partition = PartitionList(List=ma_2.PartialResults, Size=lng)

# ----
item_3 = ListItem(List=simplify, Index="0", Wrap=True)
cull_i_2 = CullIndex(List=simplify, Indices="0", Wrap=True)  # -> simplify(List)

tstat = TreeStatistics(Tree=simplify)  # -> Paths, Length, Count
lng_2 = ListLength(List=simplify)
item_4 = ListItem(List=tstat.Length, Index=0, Wrap=True)
equals = Equality(FirstNumber=lng_2, SecondNumber=item_4)  # -> Equality, Inequality
ma_3 = MassAddition(Input=flatten(equals.Equality))  # -> Result, PartialResults
match = MatchTree(Tree=partition, Guide=simplify)
equals_2 = Equality(FirstNumber=tstat.Count, SecondNumber=ma_3.Result)  # -> Equality, Inequality
gate = StreamGate(Stream=simplify, Gate=equals_2.Equality)  # -> Target0, Target1

# ---- group: retraction calculation
item_5 = ListItem(List=match, Index="-1", Wrap=True)
tolerance_resolution = Number(stepback_retraction_setting_2)
expression_5 = Expression(x=item_5, y=tolerance_resolution, Expression="x-y")
flatten = FlattenTree(Tree=expression_5, Path="{0}")
ins = InsertItems(List=flatten, Item="0", Indices="0", Wrap=True)  # -> flatten(List)

# ----
tstat_2 = TreeStatistics(Tree=gate.Target1)  # -> Paths, Length, Count
trim = TrimTree(Tree=gate.Target0, Depth=1)
tstat_3 = TreeStatistics(Tree=trim)  # -> Paths, Length, Count
series = Series(Start="1", Step=1, Count=tstat_2.Count)  # -> graft(Series)
pt_2 = Point(cull_i_2)
panel = Panel("""-1
-2
-3""")
series_2 = Series(Start="1", Step=1, Count=tstat_3.Count)  # -> graft(Series)
num = Number(match)
pt_3 = Point(item_3)
match_2 = MatchTree(Tree=series, Guide=gate.Target1)
item_6 = ListItem(List=pt_2, Index="-1", Wrap=True)
match_3 = MatchTree(Tree=series_2, Guide=trim)
item_7 = ListItem(List=pt_2, Index="-3", Wrap=True)
item_8 = ListItem(List=pt_2, Index=panel, Wrap=True)
item_9 = ListItem(List=pt_2, Index="-1", Wrap=True)
Z = UnitZ(Factor=F)
graft = GraftTree(Tree=match_3, IncludeEmptyLists=True, IncludeNullItems=True)
graft_2 = GraftTree(Tree=match_2, IncludeEmptyLists=True, IncludeNullItems=True)
filter = StreamFilter(Gate=pressure_control, Stream0=item_9, Stream1=item_8)
filter_2 = StreamFilter(Gate=pressure_control, Stream0=item_6, Stream1=item_7)
merge = Merge(Data1=graft_2, Data2=graft)
move = Move(Geometry=filter_2, Motion=Z)  # -> Geometry, Transform
move_2 = Move(Geometry=pt_3, Motion=Z)  # -> Geometry, Transform
graft_3 = GraftTree(Tree=ins, IncludeEmptyLists=True, IncludeNullItems=True)
int = Integer(merge)
panel_2 = Panel("""200
500
500
200""")

# ---- group: saftey movements
merge_2 = Merge(Data1=filter, Data2=move.Geometry)
merge_3 = Merge(Data1=move_2.Geometry, Data2=pt_3)

# ----
expression_6 = Expression(
    P=pt_2,
    PrintSpeedF=print_speed_f_mm_s_2,
    Extrusion=num,
    Expression="Format(\"G1 X{0:0.00} Y{1:0.00} Z{2:0.00} F{3,0} E{4:0.00}\", P.x, P.y, P.z, PrintSpeedF, Extrusion)")
filter_3 = StreamFilter(Gate=pressure_control, Stream0=jog_speed_f_mm_s_2, Stream1=panel_2)
expression_7 = Expression(
    P=pt_2,
    PrintSpeedF=print_speed_f_mm_s_2,
    Expression="Format(\"G1 X{0:0.00} Y{1:0.00} Z{2:0.00} F{3,0}\", P.x, P.y, P.z, PrintSpeedF)")
expression_8 = Expression(
    P=merge_3,
    JogSpeedF=jog_speed_f_mm_s_2,
    Expression="Format(\"G0 X{0:0.00} Y{1:0.00} Z{2:0.00} F{3,0} \", P.x, P.y, P.z, JogSpeedF)")
expression_9 = Expression(
    P=merge_2,
    JogSpeedF=filter_3,
    Expression="Format(\"G0 X{0:0.00} Y{1:0.00} Z{2:0.00} F{3,0} \", P.x, P.y, P.z, JogSpeedF)")

# ---- group: retraction
expression_10 = Expression(
    PointsDataMatch=pt_3,
    PrintSpeedF=print_speed_f_mm_s_2,
    back=graft_3,
    Expression="Format(\"G1 F{0,0} E{1:0.00}\", PrintSpeedF, back)")

# ----
expression_11 = Expression(n=int, Expression="Format(\";Layer # {0}\", n)")
gate_2 = StreamGate(Stream=expression_10, Gate=pressure_control)  # -> Target0, Target1

panel_3 = Panel("""M106 P0 S255
M107""")
filter_4 = StreamFilter(Gate=pressure_control, Stream0=expression_6, Stream1=expression_7)
panel_4 = Panel("""0
-1""")
ins_2 = InsertItems(List=filter_4, Item=panel_3, Indices=panel_4, Wrap=True)
concat_4 = Concatenate(FragmentA="G4 ", FragmentB="P", FragmentC=extrusion_wait)
panel_5 = Panel("""1
-1""")
ins_3 = InsertItems(List=ins_2, Item=concat_4, Indices=panel_5, Wrap=True)
panel_6 = Panel("""0
-3""")
ins_4 = InsertItems(List=ins_3, Item="M400", Indices=panel_6, Wrap=True)
trim_2 = TrimTree(Tree=ins_4, Depth="3")
filter_5 = StreamFilter(Gate=pressure_control, Stream0=filter_4, Stream1=trim_2)

merge_4 = Merge(
    Data1=simplify(expression_11),
    Data2=simplify(gate_2.Target0),
    Data3=simplify(expression_8),
    Data4=simplify(filter_5),
    Data5=simplify(expression_9))
entwine = Entwine(Branch00=g_code_header, Branch01=merge_4, Branch02=g_code_footer, FlattenInputs=True)  # -> flatten(Result)
panel_7 = Panel(merge_4)
g_code_output = Text(entwine)
total_print_lenght = Text(concat)
total_print_volume = Text(concat_3)
total_print_time = Text(concat_2)
panel_8 = Panel(entwine)
g_code_output_2 = ClusterOutput(g_code_output)
total_print_lenght_2 = ClusterOutput(total_print_lenght)
total_print_volume_2 = ClusterOutput(total_print_volume)
total_print_time_2 = ClusterOutput(total_print_time)

# ==== cluster SLICING
tolerance_resolution = ClusterInput()
tolerance_resolution_2 = ClusterInput()
noozle_diameter = ClusterInput()
z_height_offset = ClusterInput()
slicing_distance = ClusterInput()
geometry = ClusterInput()
tolerance_resolution_3 = Number(tolerance_resolution)
tolerance_resolution_4 = Number(tolerance_resolution_2)
slicing_distance_2 = Number(slicing_distance)
noozle_diameter_2 = Number(noozle_diameter)
z_height_offset_2 = Number(z_height_offset)
geometry_2 = Geometry(geometry)
panel = Panel(tolerance_resolution_4)
contour = Contour(Shape=geometry_2, Point=Point(0, 0, 0), Direction=Vector(0, 0, 1), Distance=slicing_distance_2)
bbox = BoundingBox(Content=contour, Plane=PlaneXY(0, 0, 0), UnionBox=True)  # -> flatten(Box), Box_2
center = Center(Geometrical=bbox.Box)  # -> Center, Dimension
pdecon = Deconstruct(Point=center.Center)  # -> XComponent, YComponent, ZComponent
sort = SortList(Keys=pdecon.ZComponent, ValuesA=center.Center)  # -> Keys, ValuesA
item = ListItem(List=sort.ValuesA, Index=0, Wrap=True)
xy = XYPlane(Origin=Point(0, 0, 0))
move2pt = MoveToPoint(Geometry=contour, PointA=item, PointB=xy)  # -> Moved, Vector, Transform
Z = UnitZ(Factor=z_height_offset_2)
lng = ListLength(List=flatten(geometry_2))
move = Move(Geometry=contour, Motion=Z)  # -> Geometry, Transform
simplify = SimplifyTree(Tree=move.Geometry, Front=False)
equals = Equality(FirstNumber=lng, SecondNumber="1")  # -> Equality, Inequality
sliced_geometry = Curve(simplify)
topoly = CurveToPolyline(Curve=sliced_geometry, ToleranceDistance=tolerance_resolution_3, ToleranceAngle=0, MaxEdge=tolerance_resolution_4)  # -> Polyline, Segments
merge = Merge(Data1=equals.Inequality, Data2=slicing_distance_2, Data3=noozle_diameter_2)
flatten = FlattenTree(Tree=topoly.Polyline, Path="{0}")
center_2 = Center(Geometry=flatten)  # -> Center, Dimension
# Put the curves with the same Z VALUE
# into the same Layer
expression = Expression(x=center_2.Center, Expression="x.z")
# Keys
sort_2 = SortList(Keys=expression, ValuesA=flatten)  # -> Keys, ValuesA
cset = CreateSet(List=sort_2.Keys)  # -> Set, Map
num = Number(cset.Set)
num_2 = Number(sort_2.Keys)
# x Layers
# number of items
# in each layer
mindex = MemberIndex(Set=num_2, Member=num)  # -> Index, Count
# Safety Part to have all the circles in the
# same Branch
item_2 = ListItem(List=sort_2.ValuesA, Index=mindex.Index, Wrap=True)
center_3 = Center(Geometry=item_2)  # -> Center, Dimension
avr = Average(Input=center_3.Center)
cir = Circle(Plane=avr, Radius=1)
alongcrv = SortAlongCurve(Points=center_3.Center, Curve=cir)  # -> Points, Indices
item_3 = ListItem(List=item_2, Index=alongcrv.Indices, Wrap=True)
tstat = TreeStatistics(Tree=item_3)  # -> Paths, Length, Count
dispatch = Dispatch(List=tstat.Paths, DispatchPattern=[True, False])  # -> ListA, ListB
branch = TreeBranch(Tree=item_3, Path=dispatch.ListA, MaintainPaths=True)
branch_2 = TreeBranch(Tree=item_3, Path=dispatch.ListB, MaintainPaths=True)
rev = ReverseList(List=branch_2)
settings_flow = Data(merge)
merge_2 = Merge(Data1=branch, Data2=rev)
sliced_geometry_2 = Geometry(merge_2)
sliced_geometry_3 = ClusterOutput(sliced_geometry_2)
settings_flow_2 = ClusterOutput(settings_flow)

# ==== cluster Cluster_3
data = Data()
custom_start_gcode = ClusterInput()
custom_endgcode = ClusterInput()
merge = Merge(Data1=data)
custom_start_gcode_2 = Data(custom_start_gcode)
custom_endgcode_2 = Data(custom_endgcode)
merge_2 = Merge(Data1=custom_start_gcode_2, Data2=custom_endgcode_2)  # -> graft(Result)
data_2 = Data(merge)
null = NullItem(Item=data_2)  # -> NullFlags, InvalidFlags, Description
ma = MassMultiplication(Input=null.NullFlags)  # -> Result, PartialResults
filter = StreamFilter(Gate=ma.Result, Stream0=merge, Stream1=merge_2)
start_endgcode = Data(filter)
start_endgcode_2 = ClusterOutput(start_endgcode)

# ==== cluster Cluster_4
data = ClusterInput()
data_2 = ClusterInput()
data_3 = ClusterInput()
data_4 = ClusterInput()
data_5 = ClusterInput()
data_6 = ClusterInput()
data_7 = ClusterInput()
data_8 = ClusterInput()
data_9 = ClusterInput()
data_10 = ClusterInput()
data_11 = ClusterInput()
data_12 = ClusterInput()
data_13 = ClusterInput()
data_14 = ClusterInput()
data_15 = ClusterInput()
data_16 = Data(data)
data_17 = Data(data_2)
data_18 = Data(data_3)
data_19 = Data(data_4)
data_20 = Data(data_5)
data_21 = ClusterInput()
data_22 = Data(data_6)
data_23 = Data(data_7)
data_24 = Data(data_8)
data_25 = ClusterInput()
data_26 = Data(data_9)
data_27 = Data(data_10)
data_28 = Data(data_11)
data_29 = Data(data_12)
data_30 = Data(data_13)
data_31 = Data(data_14)
data_32 = Data(data_15)
data_33 = Data(data_21)
data_34 = Data(data_25)
xor = GateXor(A=data_19, B=data_18)
dom = ConstructDomain(DomainStart=Slider(0, range=0..1), DomainEnd=Slider(1, range=0..1))
and = GateAnd(A=data_17, B=data_16)
dom_2 = ConstructDomain(DomainStart=Slider(0, range=0..1), DomainEnd=Slider(300, range=0..1000))
dom_3 = ConstructDomain(DomainStart=Slider(0, range=0..1), DomainEnd=Slider(300, range=0..1000))
constrain = Constrain(Number=data_23, Domain=dom)
filter = StreamFilter(Gate=xor, Stream0="G21 ;Set to metric")
filter_2 = StreamFilter(Gate=data_19, Stream1="G21 ;Set to metric")
filter_3 = StreamFilter(Gate=data_18, Stream1="G20 ;Set to inch")
constrain_2 = Constrain(Number=data_27, Domain=dom_2)
constrain_3 = Constrain(Number=data_32, Domain=dom_3)
subtraction = Subtraction(A="1", B=constrain)
merge = Merge(Data1=filter_2, Data2=filter_3, Data3=filter)
filter_4 = StreamFilter(Gate=and, Stream0="T0", Stream1="T1")
data_35 = Data(subtraction)
data_36 = Data(constrain)
concat = Concatenate(FragmentA=" S", FragmentB=constrain_2)
concat_2 = Concatenate(FragmentA=" S", FragmentB=constrain_3)
concat_3 = Concatenate(FragmentA="M190", FragmentB=concat)
concat_4 = Concatenate(FragmentA="M140", FragmentB=concat)
concat_5 = Concatenate(FragmentA="M109", FragmentB=concat_2)
concat_6 = Concatenate(FragmentA="M104", FragmentB=concat_2)
concat_7 = Concatenate(FragmentA=" P", FragmentB=data_36)
merge_2 = Merge(Data1=concat_4, Data2="M105", Data3=concat_3)
merge_3 = Merge(Data1=concat_6, Data2="M105", Data3=concat_5)
concat_8 = Concatenate(FragmentA=" P", FragmentB=data_35)
panel = Panel(filter_4)
null = NullItem(Item=data_26)  # -> NullFlags, InvalidFlags, Description
concat_9 = Concatenate(FragmentA="Z", FragmentB=data_26)
concat_10 = Concatenate(FragmentA="M163 S0", FragmentB=concat_7)
concat_11 = Concatenate(FragmentA="M163 S1", FragmentB=concat_8)
filter_5 = StreamFilter(Gate=data_31, Stream1=merge_2)
filter_6 = StreamFilter(Gate=data_30, Stream1=merge_3)
concat_12 = Concatenate(FragmentA="G1 ", FragmentB=concat_9)
merge_4 = Merge(Data1=concat_10, Data2=concat_11, Data3="M164 S0", Data4="T0")
filter_7 = StreamFilter(Gate=data_28, Stream1="M84")
filter_8 = StreamFilter(Gate=data_22, Stream0=filter_4, Stream1=merge_4)
filter_9 = StreamFilter(Gate=data_31, Stream1="M140 S0")
filter_10 = StreamFilter(Gate=data_30, Stream1="M104 S0")
filter_11 = StreamFilter(Gate=null.NullFlags, Stream0=concat_12)
filter_12 = StreamFilter(Gate=data_29, Stream1="M107")
filter_13 = StreamFilter(Gate=data_24, Stream0=filter_11, Stream1="G28")
filter_14 = StreamFilter(Gate=data_29, Stream0="M107", Stream1="M106 S255")
panel_2 = Panel(filter_8)
panel_3 = Panel(merge)
merge_5 = Merge(Data1=filter_14, Data2=filter_6, Data3=filter_5)
filter_15 = StreamFilter(Gate=data_20, Stream0=merge_5, Stream1="M302 P1 ; Enable cold extrude")
panel_4 = Panel(merge_5)
merge_6 = Merge(Data1=";End_gcode", Data2=filter_10, Data3=filter_9, Data4=filter_12)
merge_7 = Merge(
    Data1=";Start_Gcode",
    Data2=panel_3,
    Data3="G90 ;Absolute Coordinate System",
    Data4="G28 ;Home",
    Data6="G92 E0",
    Data7=panel_2,
    Data8=filter_15,
    Data9="M117 Printing...",
    Data10=";ENDHEADER")
panel_5 = Panel(merge_6)
header = Panel(merge_7)
merge_8 = Merge(Data1=merge_6, Data2="G92 E0", Data3=filter_13, Data4="G1 E-10 F500", Data5="M84", Data6="M90", Data7=filter_7)
data_37 = Data(merge_7)
panel_6 = Panel(merge_8)
custom_start_gcode = Data(data_33)
custom_endgcode = Data(data_34)
null_2 = NullItem(Item=custom_endgcode)  # -> NullFlags, InvalidFlags, Description
null_3 = NullItem(Item=custom_start_gcode)  # -> NullFlags, InvalidFlags, Description
filter_16 = StreamFilter(Gate=null_2.NullFlags, Stream0=custom_endgcode, Stream1=merge_8)
filter_17 = StreamFilter(Gate=null_3.NullFlags, Stream0=custom_start_gcode, Stream1=data_37)
entwine = Entwine(Branch00=filter_17, Branch01=filter_16, FlattenInputs=True)
start_endgcode = ClusterOutput(entwine)
panel_7 = Panel(entwine)

# ==== cluster Cluster_5
number_slider = Slider(1.5, range=0..10)
S = ClusterInput()
contour = Contour(Shape=S, Point=Point(0, 0, 0), Direction=Vector(0, 0, 1), Distance=number_slider)
crv = Curve(contour)
topoly = CurveToPolyline(Curve=crv, ToleranceDistance=Slider(0.05, range=0..0.1), ToleranceAngle=0)  # -> Polyline, Segments
mpipe = MeshPipe(Polylines=topoly.Polyline, NumberOfSides=Slider(8, range=0..10), Radius=number_slider, Cap=False)
unim = UnifyMesh(Mesh=mpipe)  # -> Result, Count
R = ClusterOutput(unim.Result)
